# Grasshopper definition 20181005_tim_parentRectangle.gh (Grasshopper 1.0.4)

pt = Point(Point(-4.27978995, -8.000737995, 0))
原点 = Point(pt)
角度 = Integer(Slider(0, range=0..360))
边号 = Integer([Slider(0, range=0..3), Slider(2, range=0..3)])
位距 = Number([Slider(5.61, range=0..20), Slider(5.48, range=0..20)])
boolean = Boolean([Toggle(False), Toggle(True)])
偏移 = Number([Slider(0, range=0..10), Slider(0, range=0..10)])
相位 = Integer([Slider(0, range=0..3), Slider(1, range=0..3)])
宽深 = Number([Slider(6.17, range=0..100), Slider(3.33, range=0..100)])
pt_2 = PointOriented(BasePlane=原点, UComponent=0, VComponent=0, WComponent=0)
rad = Radians(Degrees=角度)
item = ListItem(List=相位, Index="0", Wrap=True)
path = DataPath("0")
prot = RotatePlane(Plane=pt_2, Angle=rad)
lng = ListLength(List=相位)
series = Series(Start=相位, Step=1, Count=3)
mod = Modulus(A=相位, B=2)
addition = Addition(A=item, B=边号)

# ---- group: 非短路判断
mod_2 = Modulus(A=addition, B=2)
item_2 = ListItem(List=宽深, Index=mod_2, Wrap=True)
larger = LargerThan(FirstNumber=位距, SecondNumber=item_2)  # -> LargerThan, OrEqualTo
and = GateAnd(A=larger.LargerThan, B=boolean)
sift = SiftPattern(List=graft(位距), SiftPattern=graft(and))  # -> Output0, Output1
sift_2 = SiftPattern(List=graft(item_2), SiftPattern=graft(and))  # -> Output0, Output1
combine = CombineData(Input0=sift.Output0, Input1=sift_2.Output1)  # -> Result, Index
实位距 = Number(combine.Result)

# ----
panel = Panel("""0
0.5*Pi
Pi
1.5*Pi""")
pln = Plane(prot)
panel_2 = Panel("""0,1,0
1,0,1""")
deplane = DeconstructPlane(Plane=pln)  # -> Origin, XAxis, YAxis, ZAxis
Z = UnitZ(Factor=1)
num = Number(panel)
item_3 = ListItem(List=panel_2, Index=mod, Wrap=True)
vrot = Rotate(Vector=deplane.XAxis, Axis=Z, Angle=num)
split = TextSplit(Text=item_3, Separators=",")
addition_2 = Addition(A=addition, B=1)
vec = Vector(vrot)
item_4 = ListItem(List=vec, Index=addition, Wrap=True)
item_5 = ListItem(List=vec, Index=series, Wrap=True)
item_6 = ListItem(List=宽深, Index=split, Wrap=True)
item_7 = ListItem(List=vec, Index=addition_2, Wrap=True)
vec_2 = VectorXYZ(XComponent=0, YComponent=0, ZComponent=0)  # -> Vector, Length
amp = Amplitude(Vector=item_5, Amplitude=item_6)
amp_2 = Amplitude(Vector=item_7, Amplitude=偏移)
amp_3 = Amplitude(Vector=graft(item_4), Amplitude=实位距)
stack = StackData(Data=vec_2.Vector, Stack=lng)  # -> graft(Data)
ma = MassAddition(Input=amp)  # -> Result, PartialResults
merge = Merge(Data1=stack, Data2=ma.PartialResults)
pshift = ShiftPaths(Data=merge, Offset=1)
addition_3 = Addition(A=deplane.Origin, B=pshift)
branch = TreeBranch(Tree=addition_3, Path=path, MaintainPaths=True)
item_8 = ListItem(List=branch, Index=边号, Wrap=True)
addition_4 = Addition(A=graft(item_8), B=amp_3)
addition_5 = Addition(A=addition_4, B=graft(amp_2))
pshift_2 = ShiftPaths(Data=addition_5, Offset=1)
位距点 = Point(addition_4)
偏移点 = Point(pshift_2)
位点 = Point(偏移点)
pline = PolyLine(Vertices=addition_3, Closed=True)
矩形 = Rectangle(pline)
胡廷威 = Text("7gtu1hnee0t080wi")
list = ValueList({"厂区": 0, "加油站": 1, "农田": 2, "综合楼": 3, "空地": 4, "政府机构": 5, "绿化": 6, "住宅区": 7, "沿街商铺": 8, "小区": 9, "医院": 10, "社区服务中心": 11, "停车场": 12, "学校": 13, "教堂(社)": 14}, selected="厂区")
pt_3 = Point(Point(-4.27978995, -8.000737995, 0))
parentrectangle = ParentRectangle(
    密钥=胡廷威,
    建筑类型=list,
    原点=pt_3,
    角度=Slider(0, range=0..360),
    相位=Slider(0, range=0..3),
    宽深=[Slider(6.17, range=0..100), Slider(3.33, range=0..100)],
    边号=[Slider(0, range=0..3), Slider(2, range=0..3)],
    位距=[Slider(5.61, range=0..20), Slider(5.48, range=0..20)],
    偏移=[Slider(0, range=0..10), Slider(0, range=0..10)],
    boolean=[Toggle(False), Toggle(True)])  # -> 矩形_2, 位点_2, 角度_4, 确认数据_2

# ==== cluster ParentRectangle
密钥 = ClusterInput()
建筑类型 = ClusterInput()
原点 = ClusterInput()
角度 = ClusterInput()
相位 = ClusterInput()
宽深 = ClusterInput()
分参 = ClusterInput()
边号 = ClusterInput()
位距 = ClusterInput()
偏移 = ClusterInput()
boolean = ClusterInput()
密钥_2 = Text(密钥)
建筑类型_2 = Integer(建筑类型)
原点_2 = Point(原点)
角度_2 = Integer(角度)
相位_2 = Integer(相位)
宽深_2 = Number(宽深)
分参_2 = Integer(分参)
边号_2 = Integer(边号)
位距_2 = Number(位距)
偏移_2 = Number(偏移)
boolean_2 = Boolean(boolean)
panel = Panel("""7gtu1hnee0t080wi
jihiaj77e14i0xa5""")
mindex = MemberIndex(Set=panel, Member=密钥_2)  # -> Index, Count
bool = Boolean(mindex.Count)
filter = StreamFilter(Gate=bool, Stream1=建筑类型_2)
filter_2 = StreamFilter(Gate=bool, Stream1=原点_2)
filter_3 = StreamFilter(Gate=bool, Stream1=角度_2)
filter_4 = StreamFilter(Gate=bool, Stream1=相位_2)
filter_5 = StreamFilter(Gate=bool, Stream1=宽深_2)
filter_6 = StreamFilter(Gate=bool, Stream1=分参_2)
filter_7 = StreamFilter(Gate=bool, Stream1=边号_2)
filter_8 = StreamFilter(Gate=bool, Stream1=位距_2)
filter_9 = StreamFilter(Gate=bool, Stream1=偏移_2)
filter_10 = StreamFilter(Gate=bool, Stream1=boolean_2)
cluster = Cluster(
    建筑类型=filter,
    原点=filter_2,
    角度=filter_3,
    位相=filter_4,
    宽深=filter_5,
    分参=filter_6,
    边号=filter_7,
    位距=filter_8,
    偏移=filter_9,
    boolean=filter_10)  # -> 矩形_2, 位点_2, 角度_3, 确认数据_2
矩形 = Rectangle(cluster.矩形_2)
位点 = Point(cluster.位点_2)
角度_3 = Integer(cluster.角度_3)
确认数据 = Data(cluster.确认数据_2)
矩形_2 = ClusterOutput(矩形)
位点_2 = ClusterOutput(位点)
角度_4 = ClusterOutput(角度_3)
确认数据_2 = ClusterOutput(确认数据)

# ==== cluster Cluster
建筑类型 = ClusterInput()
原点 = ClusterInput()
角度 = ClusterInput()
位相 = ClusterInput()
宽深 = ClusterInput()
边号 = ClusterInput()
位距 = ClusterInput()
偏移 = ClusterInput()
boolean = ClusterInput()
分参 = ClusterInput()
建筑类型_2 = Text(建筑类型)
原点_2 = Point(原点)
角度_2 = Integer(角度)
边号_2 = Integer(边号)
boolean_2 = Boolean(boolean)
位距_2 = Number(位距)
偏移_2 = Number(偏移)
位相_2 = Integer(位相)
宽深_2 = Number(宽深)
分参_2 = Integer(分参)
pt = PointOriented(BasePlane=原点_2, UComponent=0, VComponent=0, WComponent=0)
rad = Radians(Degrees=角度_2)
item = ListItem(List=位相_2, Index="0", Wrap=True)
path = DataPath("0")
prot = RotatePlane(Plane=pt, Angle=rad)
lng = ListLength(List=位相_2)
series = Series(Start=位相_2, Step=1, Count=3)
mod = Modulus(A=位相_2, B=2)
addition = Addition(A=item, B=边号_2)

# ---- group: 非短路判断
mod_2 = Modulus(A=addition, B=2)
item_2 = ListItem(List=宽深_2, Index=mod_2, Wrap=True)
larger = LargerThan(FirstNumber=位距_2, SecondNumber=item_2)  # -> LargerThan, OrEqualTo
and = GateAnd(A=larger.LargerThan, B=boolean_2)
sift = SiftPattern(List=graft(位距_2), SiftPattern=graft(and))  # -> Output0, Output1
sift_2 = SiftPattern(List=graft(item_2), SiftPattern=graft(and))  # -> Output0, Output1
combine = CombineData(Input0=sift.Output0, Input1=sift_2.Output1)  # -> Result, Index
pshift = ShiftPaths(Data=combine.Result, Offset=-1)
实位距 = Number(pshift)

# ----
panel = Panel("""0
0.5*Pi
Pi
1.5*Pi""")
pln = Plane(prot)
panel_2 = Panel("""0,1,0
1,0,1""")
deplane = DeconstructPlane(Plane=pln)  # -> Origin, XAxis, YAxis, ZAxis
Z = UnitZ(Factor=1)
num = Number(panel)
item_3 = ListItem(List=panel_2, Index=mod, Wrap=True)
vrot = Rotate(Vector=deplane.XAxis, Axis=Z, Angle=num)
split = TextSplit(Text=item_3, Separators=",")
addition_2 = Addition(A=addition, B=1)
vec = Vector(vrot)
item_4 = ListItem(List=vec, Index=addition, Wrap=True)
item_5 = ListItem(List=vec, Index=series, Wrap=True)
item_6 = ListItem(List=宽深_2, Index=split, Wrap=True)
item_7 = ListItem(List=vec, Index=addition_2, Wrap=True)
vec_2 = VectorXYZ(XComponent=0, YComponent=0, ZComponent=0)  # -> Vector, Length
amp = Amplitude(Vector=item_5, Amplitude=item_6)
amp_2 = Amplitude(Vector=item_7, Amplitude=偏移_2)
amp_3 = Amplitude(Vector=item_4, Amplitude=实位距)
stack = StackData(Data=vec_2.Vector, Stack=lng)  # -> graft(Data)
ma = MassAddition(Input=amp)  # -> Result, PartialResults
merge = Merge(Data1=stack, Data2=ma.PartialResults)
pshift_2 = ShiftPaths(Data=merge, Offset=1)
addition_3 = Addition(A=deplane.Origin, B=pshift_2)
branch = TreeBranch(Tree=addition_3, Path=path, MaintainPaths=True)
item_8 = ListItem(List=branch, Index=边号_2, Wrap=True)
addition_4 = Addition(A=item_8, B=amp_3)
addition_5 = Addition(A=addition_4, B=amp_2)
位距点 = Point(addition_4)
偏移点 = Point(addition_5)
位点 = Point(偏移点)
pline = PolyLine(Vertices=addition_3, Closed=True)
entwine = Entwine(
    Branch00=建筑类型_2,
    Branch01=原点_2,
    Branch02=角度_2,
    Branch03=位相_2,
    Branch04=宽深_2,
    Branch05=分参_2,
    Branch06=边号_2,
    Branch07=位距_2,
    Branch08=偏移_2,
    Branch09=boolean_2,
    FlattenInputs=True)
矩形 = Rectangle(pline)
确认数据 = Data(entwine)
矩形_2 = ClusterOutput(矩形)
位点_2 = ClusterOutput(位点)
角度_3 = ClusterOutput(角度_2)
确认数据_2 = ClusterOutput(确认数据)
