# Grasshopper definition 20181009_tim_ExcelReadAndWrite.gh (Grasshopper 1.0.4)

读取excel0_2 = 读取Excel02(结构=False)
读取excel0_1 = 读取Excel01()  # disabled
写入excel0_1 = 写入Excel01()

# ==== cluster 读取Excel01
开读 = ClusterInput()
路径 = ClusterInput()
表名 = ClusterInput()
列号 = ClusterInput()
首行 = ClusterInput()
尾行 = ClusterInput()
结构 = ClusterInput()
表名_2 = Text(表名)
开读_2 = Boolean(开读)
路径_2 = Text(路径)
列号_2 = Integer(列号)
首行_2 = Integer(首行)
尾行_2 = Integer(尾行)
结构_2 = Boolean(结构)
vb = VBScript(read=开读_2, FilePath=路径_2, SheetName=表名_2, Column=列号_2, startRow=首行_2, endRow=尾行_2, isStructed=结构_2)  # -> out, A
# ---------- vb: VB ----------
    If read = True Then
      Dim xl As Object
      Dim xlbook As Object
      xl = CreateObject("excel.application")
      'xl.Visible = False
      Dim st As Object
      xlbook = xl.Workbooks.Open(FilePath)
      st = xlbook.Worksheets(SheetName)

      'Dim ans As String
      'ans = st.Cells(i, j).Value
      Dim i As Integer
      Dim lst(endRow-startRow) As String
      Dim value As String
      Dim j As Integer
      j = 0
      For i = startRow To endRow Step 1
        value = st.Cells(i, Column).value
        If (value = "" And isStructed = False) Then
          Continue For
        End If
        'lst.AddItems(value)
        lst(j) = value
        j = j + 1
      Next
      ReDim Preserve lst(j-1)
      'A = st.Cells(i, Column).Value
      A = lst
      xl = Nothing
      xlbook = Nothing
    End If
# ---------- end vb ----------
数据 = Data(vb.A)
数据_2 = ClusterOutput(数据)

# ==== cluster 写入Excel01
开写 = ClusterInput()
路径 = ClusterInput()
数据 = ClusterInput()
表名 = ClusterInput()
标题 = ClusterInput()
列号 = ClusterInput()
首行 = ClusterInput()
结构 = ClusterInput()
数据_2 = Data(数据)
结构_2 = Boolean(结构)
开写_2 = Boolean(开写)
路径_2 = Text(路径)
表名_2 = Text(表名)
标题_2 = Text(标题)
列号_2 = Integer(列号)
首行_2 = Integer(首行)
vb = VBScript(Write=开写_2, FilePath=路径_2, Data=数据_2, SheetName=表名_2, TableName=标题_2, Column=列号_2, startRow=首行_2, isStructed=结构_2)  # -> out, A; inputs Data: list
# ---------- vb: VB ----------
    If Write = True Then
      Dim xl As Object
      Dim xlbook As Object
      xl = CreateObject("excel.application")
      'xl.Visible = False
      Dim st As Object
      xlbook = xl.Workbooks.Open(FilePath)
      'check sheet exists

      Dim find As Boolean
      find = False
      Dim i As Integer
      For Each st In xlbook.WorkSheets
        If st.name = SheetName Then
          find = True
          Exit For
        End If
      Next
      If find = False Then
        st = xlbook.Worksheets.Add()
        st.Name = SheetName
      Else
        'has exists
        st = xlbook.Worksheets(SheetName)
      End If
      A = st.Name
      With st
        .Cells(startRow, Column) = TableName
        'Dim i As Integer
        Dim length As Integer
        length = Data.Count() - 1
        Dim j As Integer
        j = startRow + 1
        For i = 0 To length Step 1
          If Data(i) = "" And isStructed = False Then
            Continue For
          End If
          .Cells(j, Column) = Data(i)
          j = j + 1
        Next
        
        xlbook.Save()
        xlbook.Close()
        xl.Quit()
      End With
      xl = Nothing
      xlbook = Nothing
    End If
# ---------- end vb ----------

# ==== cluster 读取Excel02
开读 = ClusterInput()
路径 = ClusterInput()
表名 = ClusterInput()
列号 = ClusterInput()
首行 = ClusterInput()
尾行 = ClusterInput()
结构 = ClusterInput()
表名_2 = Text(表名)
开读_2 = Boolean(开读)
路径_2 = Text(路径)
列号_2 = Integer(列号)
首行_2 = Integer(首行)
尾行_2 = Integer(尾行)
结构_2 = Boolean(结构)
vb = VBScript(read=开读_2, FilePath=路径_2, SheetName=表名_2, Column=列号_2, startRow=首行_2, endRow=尾行_2, isStructed=结构_2)  # -> out, A
# ---------- vb: VB ----------
    If read = True Then
      Dim xl As Object
      Dim xlbook As Object
      xl = CreateObject("excel.application")
      'xl.Visible = False
      Dim st As Object
      xlbook = xl.Workbooks.Open(FilePath)
      st = xlbook.Worksheets(SheetName)

      'Dim ans As String
      'ans = st.Cells(i, j).Value
      Dim i As Integer
      Dim lst(endRow-startRow) As String
      Dim value As String
      Dim j As Integer
      j = 0
      For i = startRow To endRow Step 1
        value = st.Cells(i, Column).value
        If (value = "" And isStructed = False) Then
          Continue For
        End If
        lst(j) = value
        j = j + 1
      Next
      ReDim Preserve lst(j - 1)
      A = lst
      xl.Workbooks.close
      xl.quit
      xl = Nothing
      xlbook = Nothing
    End If
# ---------- end vb ----------
数据 = Data(vb.A)
数据_2 = ClusterOutput(数据)
