# Grasshopper definition 20181009_tim_ModelImport.gh (Grasshopper 1.0.4)

panel = Panel("""import::工厂
import::学校""")
list = ValueList({"按建筑类型": 0, "按地块编号": 1}, selected="按建筑类型")
int = Integer(list)
int_2 = Integer(Slider(17, range=0..100))
txt = Text(panel)
txt_2 = Text(["C:\Users\htwt\Desktop\model-demo\04-02.skp", "C:\Users\htwt\Desktop\model-demo\01-02.skp"])
pt = Point([Point(-3.745166838, -25.74614871, 0), Point(25.73268866, -42.67282174, 0), Point(26.54303433, -7.37462642, 0), Point(6.723286728, 10.88844698, 0), Point(36.34438012, 19.53725543, 0)])
python = GhPythonScript(flag=Toggle(False), clear_flag=Toggle(False), filepath=txt_2, coord=pt, angle=int_2, layerName=txt)  # -> out, a; inputs flag: Boolean, clear_flag: Boolean, coord: Point3d, angle: Int32; same code as python
panel_2 = Panel("""import::工厂
import::学校""")
int_3 = Integer(Slider(17, range=0..100))
txt_3 = Text(panel_2)
txt_4 = Text(["C:\Users\htwt\Desktop\model-demo\04-02.skp", "C:\Users\htwt\Desktop\model-demo\01-02.skp"])
pt_2 = Point([Point(-3.745166838, -25.74614871, 0), Point(25.73268866, -42.67282174, 0), Point(26.54303433, -7.37462642, 0), Point(6.723286728, 10.88844698, 0), Point(36.34438012, 19.53725543, 0)])
模型导入0_1 = 模型导入01(开导=Toggle(False), 清除=Toggle(False), 路径=txt_4, 位点=pt_2, 角度=int_3, 图层=txt_3)

# ==== cluster 模型导入01
开导 = ClusterInput()
清除 = ClusterInput()
路径 = ClusterInput()
位点 = ClusterInput()
角度 = ClusterInput()
图层 = ClusterInput()
开导_2 = Boolean(开导)
清除_2 = Boolean(清除)
路径_2 = Text(路径)
位点_2 = Point(位点)
角度_2 = Integer(角度)
图层_2 = Text(图层)
python = GhPythonScript(flag=开导_2, clear_flag=清除_2, filepath=路径_2, coord=位点_2, angle=角度_2, layerName=图层_2)  # -> out, a; inputs flag: Boolean, clear_flag: Boolean, coord: Point3d, angle: Int32
# ---------- python: Python ----------
__author__ = "htwt"
__version__ = "2018.10.10"

import rhinoscriptsyntax as rs
import scriptcontext as sc
import Rhino
import math
import os

def changeModelLayer(obj, layerName):
    rs.ObjectLayer(obj, rs.AddLayer(layerName))

def rotateMat(angle):
    radians = math.radians(angle)
    c = math.cos(radians)
    s = math.sin(radians)
    matrix = []
    matrix.append( [c,-s, 0, 0] )
    matrix.append( [s, c, 0, 0] )
    matrix.append( [0, 0, 1, 0] )
    matrix.append( [0, 0, 0, 1] )
    return matrix

def moveMat(coord):
    matrix = rs.XformTranslation(coord)
    return matrix

def transformModel(obj, coord, angle):
    xform = rs.XformMultiply(moveMat(coord), rotateMat(angle))
    rs.TransformObject( obj, xform, False)

def importModel(filepath, coords, angle):
    rs.Command("_-import " + filepath + " _Enter")
    obj_id = rs.LastCreatedObjects()
    if obj_id:
        # changeLayerByName
        changeModelLayer(obj_id, layerName)
        # move&rotate
        transformModel(obj_id, coord, angle)

def clear(layerName):
    if rs.IsLayer(layerName): rs.PurgeLayer(layerName)

def main(flag):
    sc.doc = Rhino.RhinoDoc.ActiveDoc
    if flag:
        importModel(filepath, coord, angle)
    if clear_flag:
        clear(layerName)
    sc.doc = ghdoc

main(flag)
# ---------- end python ----------
