# Grasshopper definition 20181012_tim_firstStepDesign.gh (Grasshopper 1.0.4)

道路始末位置 = Point()
建筑类型表 = Text()
data = Data()
data_2 = Data()
职业表 = Text()
各职业不同时段实际场所表 = Text()
实际场所与建筑类型映射表 = Integer()
各职业人数 = Integer()
位点 = Point()
角度 = Point()
相位 = Point()
宽深 = Point()

角度_2 = Point()
相位_2 = Point()
panel = Panel([角度_2, 相位_2])
实际角度 = Point(panel)
位点_2 = Point(位点)
角度_3 = Point(实际角度)
宽深_2 = Point(宽深)
文件路径 = Text()
模型 = Data()
panel_2 = Panel([位点_2, 角度_3, 宽深_2, 模型, 文件路径])
导入结果 = Data(panel_2)

panel_3 = Panel([道路始末位置, data, data_2])
panel_4 = Panel([位点, 角度, 相位, 宽深])
中心线 = Curve(panel_3)
panel_5 = Panel([职业表, 各职业不同时段实际场所表, 实际场所与建筑类型映射表, 建筑类型表, 各职业人数])

建筑类型 = Text()
建筑矩形 = Rectangle(panel_4)
panel_6 = Panel([建筑类型, 建筑矩形])
各类型建筑数量 = Integer(panel_6)

panel_7 = Panel("""各地块类型人数
各建筑人数
不同时段人的路径""")
各时刻各建筑类型人员序号 = Integer(panel_5)
各时刻各建筑类型人数 = Integer(各时刻各建筑类型人员序号)
各类型建筑数量_2 = Integer(各类型建筑数量)
时刻序号 = Integer()
panel_8 = Panel([各时刻各建筑类型人数, 各类型建筑数量_2, 时刻序号])

路网 = Curve(中心线)
panel_9 = Panel(路网)
邻接关系 = Integer(panel_9)
路网结点 = Point(panel_9)
邻接距离 = Number(panel_9)

各建筑人数 = Integer()
某时刻各建筑人员序号 = Integer(panel_8)
panel_10 = Panel(某时刻各建筑人员序号)
各时刻建筑人员序号 = Integer(panel_10)

各建筑人员 = Integer(各时刻建筑人员序号)
建筑位点 = Point(位点)
各个人对应建筑序号 = Integer()
panel_11 = Panel([各建筑人员, 建筑位点])
某人员动向_建筑序号对 = Integer(panel_11)

现有路网 = Curve(路网)
现有路网结点 = Integer(路网结点)
结点邻接关系 = Integer(邻接关系)

# ---- group: 深度优先算法
结点序号1 = Integer()
邻接关系_2 = Integer()
结点序号2 = Integer()
panel_12 = Panel([邻接关系_2, 结点序号1, 结点序号2])
路径_结点序 = Integer(panel_12)

# ----
邻接距离_2 = Number(邻接距离)
出行方式 = Integer()

某人员动向_建筑序号对_2 = Integer(某人员动向_建筑序号对)
建筑位点_2 = Point(位点)

panel_13 = Panel([某人员动向_建筑序号对_2, 建筑位点_2])

起始点1 = Point(panel_13)
起始点2 = Point(panel_13)

起始点1_2 = Point(起始点1)
终点2 = Point(起始点2)
panel_14 = Panel([现有路网, 现有路网结点, 结点邻接关系, 起始点1_2, 终点2])
更新结点邻接关系 = Integer(panel_14)
建筑结点编号1 = Integer(panel_14)
建筑结点编号2 = Integer(panel_14)
道路建筑节点邻接关系 = Integer(更新结点邻接关系)
建筑结点编号1_2 = Integer(建筑结点编号1)
建筑结点编号2_2 = Integer(建筑结点编号2)
panel_15 = Panel([道路建筑节点邻接关系, 建筑结点编号1_2, 建筑结点编号2_2])
动向路径路径_结点序 = Integer(panel_15)
动向路径路径_结点序_2 = Integer(动向路径路径_结点序)
panel_16 = Panel([出行方式, 邻接距离_2, 动向路径路径_结点序_2])
交通时间 = Number(panel_16)
