# Grasshopper definition 20181012_tim_transportTimeDemo.gh (Grasshopper 1.0.4)

panel = Panel("""走路
自行车
电动车
摩托车
公交车
汽车""")
panel_2 = Panel("""0.5
1.2
1.7
2.5
3.23
3.88""")
txt = Text(panel)
num = Number(panel_2)
concat = Concatenate(FragmentA=txt, FragmentB=num, JoinSeparator=",")
交通工具和速度映射表_方式_速度 = Text(concat)
split = TextSplit(Text=交通工具和速度映射表_方式_速度, Separators=",")
交通工具和速度映射表_方式_速度_2 = Data(split)
item = ListItem(List=交通工具和速度映射表_方式_速度_2, Index="1", Wrap=True)  # -> flatten(Item)
list = ValueList({"走路": 0, "自行车": 1, "电动车": 2, "摩托车": 3, "公交车": 4, "汽车": 5}, selected="电动车")
出行速度表 = Number(num)
出行速度表_2 = Number(item)
出行速度表_3 = Number(出行速度表)
距离 = Number(Slider(2600, range=0..10000))
出行方式 = Integer(list)
item_2 = ListItem(List=出行速度表_3, Index=出行方式, Wrap=True)
出行速度 = Number(item_2)
division = Division(A=距离, B=出行速度)
出行时间 = Integer(division)
panel_3 = Panel(出行时间)
