# Grasshopper definition 20181013_tim_startAndEndPoints.gh (Grasshopper 1.0.4)

panel = Panel("""3
8
4
9
12
1
7
3""")
int = Integer(panel)

某人员各时刻建筑序号 = Integer()
建筑位点 = Point()
各个人对应建筑序号 = Integer()
panel_2 = Panel([某人员各时刻建筑序号, 建筑位点])
某人员动向_建筑序号对 = Integer(panel_2)

某人员各时刻建筑序号_2 = Integer(int)
动向始末点0_2 = 动向始末点02()  # -> 起始点_2, 结束点_2
动向始末点0_2_2 = 动向始末点02_2()  # -> 起始点_2, 结束点_2
动向始末点0_3 = 动向始末点03()  # -> 起始点_2, 结束点_2
建筑位点_2 = Point([Point(2283.08552, 2441.282948, 0), Point(2306.741104, 2174.619996, 0), Point(2420.718011, 2613.323562, 0), Point(2332.547196, 2378.918226, 0), Point(2515.340349, 2297.198934, 0), Point(2809.959901, 2458.48701, 0), Point(2818.561932, 2284.295888, 0), Point(2622.865733, 2146.663396, 0), Point(2663.725379, 2505.798179, 0), Point(2500.286795, 2419.777871, 0), Point(2349.751258, 1843.441814, 0), Point(2825.013455, 2009.030905, 0), Point(2549.748472, 2017.632936, 0), Point(2594.909133, 1766.023537, 0), Point(2745.444671, 2295.048426, 0), Point(2450.825119, 2163.867458, 0)])
动向始末点0_4 = 动向始末点04()  # -> 起始点_2, 结束点_2
points = PointList(Points=建筑位点_2, Size=Slider(100, range=0..100))
shift = ShiftList(List=某人员各时刻建筑序号_2, Shift=[-1, 1], Wrap=False)
pshift = ShiftPaths(Data=shift, Offset=1)
flip = FlipMatrix(Data=pshift)

某人员动向_建筑序号对_2 = Integer(某人员动向_建筑序号对)
建筑位点_3 = Point()
panel_3 = Panel([某人员动向_建筑序号对_2, 建筑位点_3])
起始点 = Point(panel_3)
结束点 = Point(panel_3)

item = ListItem(List=建筑位点_2, Index=flip, Wrap=True)
item_2 = ListItem(List=item, Index=0, Wrap=True)  # -> Item, Item1
起始点_2 = Point(item_2.Item)
结束点_2 = Point(item_2.Item1)
起始点_3 = Point(起始点_2)
结束点_3 = Point(结束点_2)
subtraction = Subtraction(A=结束点_2, B=起始点_2)
vdis = VectorDisplay(Anchor=起始点_2, Vector=subtraction)

# ==== cluster 动向始末点02
某人员各时刻建筑序号 = ClusterInput()
建筑位点 = ClusterInput()
某人员各时刻建筑序号_2 = Integer(某人员各时刻建筑序号)
建筑位点_2 = Point(建筑位点)
shift = ShiftList(List=某人员各时刻建筑序号_2, Shift=[-1, 1], Wrap=False)
pshift = ShiftPaths(Data=shift, Offset=1)
flip = FlipMatrix(Data=pshift)
item = ListItem(List=建筑位点_2, Index=flip, Wrap=True)
item_2 = ListItem(List=item, Index=0, Wrap=True)  # -> Item, Item1
起始点 = Point(item_2.Item)
结束点 = Point(item_2.Item1)
起始点_2 = ClusterOutput(起始点)
结束点_2 = ClusterOutput(结束点)

# ==== cluster 动向始末点02_2
某人员各时刻建筑序号 = ClusterInput()
建筑位点 = ClusterInput()
某人员各时刻建筑序号_2 = Integer(某人员各时刻建筑序号)
建筑位点_2 = Point(建筑位点)
shift = ShiftList(List=某人员各时刻建筑序号_2, Shift=[-1, 1], Wrap=False)
pshift = ShiftPaths(Data=shift, Offset=1)
path_mapper = PathMapper(pshift, source="{A;B}(i)", target="{A;i}(B)")
flip = FlipMatrix(Data=shift)
item = ListItem(List=建筑位点_2, Index=path_mapper, Wrap=True)
item_2 = ListItem(List=item, Index=0, Wrap=True)  # -> Item, Item1
起始点 = Point(item_2.Item)
结束点 = Point(item_2.Item1)
起始点_2 = ClusterOutput(起始点)
结束点_2 = ClusterOutput(结束点)

# ==== cluster 动向始末点03
某人员各时刻建筑序号 = ClusterInput()
建筑位点 = ClusterInput()
某人员各时刻建筑序号_2 = Integer(某人员各时刻建筑序号)
建筑位点_2 = Point(建筑位点)
shift = ShiftList(List=某人员各时刻建筑序号_2, Shift=[-1, 1], Wrap=False)
pshift = ShiftPaths(Data=shift, Offset=1)
path_mapper = PathMapper(pshift, source="{A;B}(i)", target="{A;i}(B)")
item = ListItem(List=建筑位点_2, Index=path_mapper, Wrap=True)
item_2 = ListItem(List=item, Index=0, Wrap=True)  # -> Item, Item1
pshift_2 = ShiftPaths(Data=item_2.Item1, Offset=-1)
pshift_3 = ShiftPaths(Data=item_2.Item, Offset=-1)
起始点 = Point(pshift_3)
结束点 = Point(pshift_2)
起始点_2 = ClusterOutput(起始点)
结束点_2 = ClusterOutput(结束点)

# ==== cluster 动向始末点04
某人员各时刻建筑序号 = ClusterInput()
建筑位点 = ClusterInput()
某人员各时刻建筑序号_2 = Integer(某人员各时刻建筑序号)
建筑位点_2 = Point(建筑位点)
shift = ShiftList(List=某人员各时刻建筑序号_2, Shift=[-1, 1], Wrap=False)
path_mapper = PathMapper(shift, source="{A;B;C}(i)", target="{A;B;i}(C)")
item = ListItem(List=建筑位点_2, Index=path_mapper, Wrap=True)
item_2 = ListItem(List=item, Index=0, Wrap=True)  # -> Item, Item1
pshift = ShiftPaths(Data=item_2.Item1, Offset=-1)
pshift_2 = ShiftPaths(Data=item_2.Item, Offset=-1)
起始点 = Point(pshift_2)
结束点 = Point(pshift)
起始点_2 = ClusterOutput(起始点)
结束点_2 = ClusterOutput(结束点)
