# Grasshopper definition 20181014_tim_clearOriginalData.gh (Grasshopper 1.0.4)

panel = Panel("""小区 
景区
房子""")
cluster = Cluster(手工脏数据=panel)
panel_2 = Panel(cluster)

# ==== cluster Cluster
手工脏数据 = ClusterInput()
手工脏数据_2 = Text(手工脏数据)
python = GhPythonScript(str=手工脏数据_2)  # -> out, a
# ---------- python: Python ----------
# -*- coding=utf-8 -*-
"""Provides a scripting component.
    Inputs:
        x: The x script variable
        y: The y script variable
    Output:
        a: The a output variable"""

__author__ = "htwt"
__version__ = "2018.10.14"
import os, sys, string

def filterString(str): 
    #return filter(lambda ch: ch not in '. ', str)
    return str.strip()
a = filterString(str)
# ---------- end python ----------
清理后的数据 = Text(python.a)
panel = Panel(清理后的数据)
清理后的数据_2 = ClusterOutput(清理后的数据)
