# Grasshopper definition 20181014_tim_peopleNumberArrangment.gh (Grasshopper 1.0.4)

各类人各时刻建筑类型序号表 = Integer()
各类人数分配比 = Number()
基因条人数分配0_1 = 基因条人数分配01()
总人数 = Integer()
各类人各时刻建筑类型序号表_2 = Integer(各类人各时刻建筑类型序号表)
各类人数分配比_2 = Number(各类人数分配比)
总人数_2 = Integer(总人数)
ma = MassAddition(Input=各类人数分配比_2)  # -> Result, PartialResults
join = TextJoin(Text=各类人各时刻建筑类型序号表_2, Join=",")
division = Division(A=各类人数分配比_2, B=ma.Result)
multiplication = Multiplication(A=division, B=总人数_2)
int = Integer(graft(multiplication))
stack = StackData(Data=join, Stack=int)  # -> simplify(Data)
split = TextSplit(Text=stack, Separators=",")
某人员各时刻建筑类型序号表 = Integer(split)
某人员各时刻建筑类型序号表_2 = Integer(某人员各时刻建筑类型序号表)

# ==== cluster 基因条人数分配01
各类人各时刻建筑类型序号表 = ClusterInput()
各类人数分配比 = ClusterInput()
总人数 = ClusterInput()
各类人各时刻建筑类型序号表_2 = Integer(各类人各时刻建筑类型序号表)
各类人数分配比_2 = Number(各类人数分配比)
总人数_2 = Integer(总人数)
ma = MassAddition(Input=各类人数分配比_2)  # -> Result, PartialResults
join = TextJoin(Text=各类人各时刻建筑类型序号表_2, Join=",")
division = Division(A=各类人数分配比_2, B=ma.Result)
multiplication = Multiplication(A=division, B=总人数_2)
int = Integer(graft(multiplication))
stack = StackData(Data=join, Stack=int)  # -> simplify(Data)
split = TextSplit(Text=stack, Separators=",")
某人员各时刻建筑类型序号表 = Integer(split)
某人员各时刻建筑类型序号表_2 = ClusterOutput(某人员各时刻建筑类型序号表)
