# Grasshopper definition 20181015_tim_genicConstructure.gh (Grasshopper 1.0.4)

series = Series(Start="2", Step="4", Count="4")
panel = Panel("""18
19""")
series_2 = Series(Start=series, Step=1, Count="4")
bang = ExplodeTree(Data=simplify(series_2))  # -> Branch0, Branch1, Branch2, Branch3
path = FilePath("C:\Users\htwt\Desktop\20181014_现状描述机制工作包\20181014_基因条编写\20181015_胡廷威_基因库.xls")
读取excel0_2 = 读取Excel02(开读=Toggle(False), 路径=path, 表名="政府官员", 列号=[bang.Branch0, panel], 首行="3", 尾行="7", 结构=Toggle(False))
职业 = Text("政府官员")
bang_2 = ExplodeTree(Data=simplify(读取excel0_2))  # -> Branch0, Branch1, Branch2, Branch3, Branch4, Branch5

panel_2 = Panel("""走路
自行车
电瓶车
公交车
汽车
班车""")
panel_3 = Panel("""工厂叉车司机
地头混混
幼儿园老师
啃老族
打零工
扫地工人
水果小贩
小老板
流浪汉
快递员
健身教练
出租车司机
养蜂人
小学生
中学生
工厂工人
片警
退休
政府官员
上市公司老板
渔民
厂长
货车司机
种地农民
幼儿园清洁工
中心学校校长
幼儿园学生
学校厨师长
退休老人
老年服务中心主管
村支书
派出所民警
病人
医生
水产养殖户
家庭主妇
旅游者""")
panel_4 = Panel("""普通小区
河边旧民居
别墅
船
农田自建房
工厂
菜市场
宾馆
小饭馆
农田
学校
警署
老年活动中心
医院
政府
棋牌室
公园
超市
茶馆
网吧
鱼塘
洗浴中心
咖啡馆""")
panel_5 = Panel("""否
是""")
panel_6 = Panel("""/
;
-
~""")
所有出行方式 = Text(panel_2)
所有职业 = Text(panel_3)
所有职业_2 = Text(panel_4)
item = ListItem(List=panel_6, Index=0, Wrap=True)  # -> Item, Item1, Item2, Item3
是否 = Text(panel_5)
panel_7 = Panel("""是
是
否
是""")
panel_8 = Panel("""处理文件
接待上访
走访民众
会议""")
panel_9 = Panel("""3~6
2~4
2~4
0.5~5""")
panel_10 = Panel("""政府
政府
普通小区~河边旧民居~别墅~农田自建房~工厂~农田~老年活动中心
政府""")
panel_11 = Panel("""走路
班车
汽车""")
是否重复地点 = Text(panel_7)
建筑类型 = Text(panel_10)
职业_2 = Text("政府官员")
事件 = Text(panel_8)
时间区间 = Text(panel_9)
起床区间 = Text("6:00~9:30")
出行方式 = Text(panel_11)
lng = ListLength(List=事件)
mindex = MemberIndex(Set=所有职业, Member=职业_2)  # -> Index, Count
split = TextSplit(Text=建筑类型, Separators=item.Item3)
mindex_2 = MemberIndex(Set=是否, Member=是否重复地点)  # -> Index, Count
mindex_3 = MemberIndex(Set=所有出行方式, Member=出行方式)  # -> Index, Count
series_3 = Series(Start=0, Step=1, Count=lng)
pshift = ShiftPaths(Data=mindex.Index, Offset=-1)
mindex_4 = MemberIndex(Set=所有职业_2, Member=split)  # -> Index, Count
pshift_2 = ShiftPaths(Data=mindex_2.Index, Offset=-1)
pshift_3 = ShiftPaths(Data=mindex_3.Index, Offset=-1)
pshift_4 = ShiftPaths(Data=series_3, Offset=-1)
职业序号 = Integer(pshift)
事件序号 = Integer(pshift_4)
pshift_5 = ShiftPaths(Data=mindex_4.Index, Offset=-1)
是否重复地点布尔 = Integer(pshift_2)
出行方式序号 = Integer(pshift_3)
建筑类型序号 = Text(pshift_5)
join = TextJoin(Text=事件序号, Join=item.Item2)
join_2 = TextJoin(Text=时间区间, Join=item.Item2)
join_3 = TextJoin(Text=建筑类型序号, Join=item.Item3)
join_4 = TextJoin(Text=是否重复地点布尔, Join=item.Item2)
pshift_6 = ShiftPaths(Data=join_3, Offset=-1)
join_5 = TextJoin(Text=出行方式序号, Join=item.Item2)
join_6 = TextJoin(Text=pshift_6, Join=item.Item2)
merge = Merge(Data1=join, Data2=join_2, Data3=join_6, Data4=join_4)
join_7 = TextJoin(Text=merge, Join=item.Item1)
merge_2 = Merge(Data1=职业序号, Data2=join_7, Data3=起床区间, Data4=join_5)
join_8 = TextJoin(Text=merge_2, Join=item.Item)
panel_12 = Panel(join_8)

panel_13 = Panel("""工厂叉车司机
地头混混
幼儿园老师
啃老族
打零工
扫地工人
水果小贩
小老板
流浪汉
快递员
健身教练
出租车司机
养蜂人
小学生
中学生
工厂工人
片警
退休
政府官员
上市公司老板
渔民
厂长
货车司机
种地农民
幼儿园清洁工
中心学校校长
幼儿园学生
学校厨师长
退休老人
老年服务中心主管
村支书
派出所民警
病人
医生
水产养殖户
家庭主妇
旅游者""")
panel_14 = Panel("""普通小区
河边旧民居
别墅
船
农田自建房
工厂
菜市场
宾馆
小饭馆
农田
学校
警署
老年活动中心
医院
政府
棋牌室
公园
超市
茶馆
网吧
鱼塘
洗浴中心
咖啡馆""")
panel_15 = Panel("""否
是""")
panel_16 = Panel("""走路
自行车
电瓶车
公交车
汽车
班车""")
所有职业_3 = Text(panel_13)
所有建筑类型 = Text(panel_14)
是否_2 = Text(panel_15)
所有出行方式_2 = Text(panel_16)
cluster = Cluster(
    所有职业=所有职业_3,
    所有建筑类型=所有建筑类型,
    所有是否=是否_2,
    所有出行方式=所有出行方式_2,
    职业=职业,
    事件=bang_2.Branch0,
    时间区间=bang_2.Branch1,
    建筑类型=bang_2.Branch2,
    是否重复地点=bang_2.Branch3,
    起床区间=bang_2.Branch4,
    出行方式=bang_2.Branch5)
series_4 = Series(Start="2", Step="4", Count="4")
series_5 = Series(Start=series_4, Step=1, Count="4")
bang_3 = ExplodeTree(Data=simplify(series_5))  # -> Branch0, Branch1, Branch2, Branch3
panel_17 = Panel("政府官员")
panel_18 = Panel(cluster)
toggle = BooleanToggle(False)
panel_19 = Panel("""18
19""")
toggle_2 = BooleanToggle(False)
path_2 = FilePath("C:\Users\htwt\Desktop\20181014_现状描述机制工作包\20181014_基因条编写\20181015_胡廷威_基因库.xls")
读取excel0_2_2 = 读取Excel02(开读=toggle, 路径=path_2, 表名=panel_17, 列号=bang_3.Branch0, 首行="3", 尾行="7", 结构=toggle_2)
读取excel0_2_3 = 读取Excel02(开读=toggle, 路径=path_2, 表名=panel_17, 列号=bang_3.Branch0, 首行="3", 尾行="7", 结构=toggle_2)
读取excel0_2_4 = 读取Excel02(开读=toggle, 路径=path_2, 表名=panel_17, 列号=bang_3.Branch0, 首行="3", 尾行="7", 结构=toggle_2)
读取excel0_2_5 = 读取Excel02(开读=toggle, 路径=path_2, 表名=panel_17, 列号=bang_3.Branch0, 首行="3", 尾行="7", 结构=toggle_2)
读取excel0_2_6 = 读取Excel02(开读=toggle, 路径=path_2, 表名=panel_17, 列号=panel_19, 首行="3", 尾行="7", 结构=toggle_2)
职业_3 = Text(panel_17)
bang_4 = ExplodeTree(Data=simplify(读取excel0_2_6))  # -> Branch0, Branch1
panel_20 = Panel("""普通小区
河边旧民居
别墅
船
农田自建房
工厂
菜市场
宾馆
小饭馆
农田
学校
警署
老年活动中心
医院
政府
棋牌室
公园
超市
茶馆
网吧
鱼塘
洗浴中心
咖啡馆""")
panel_21 = Panel("""工厂叉车司机
地头混混
幼儿园老师
啃老族
打零工
扫地工人
水果小贩
小老板
流浪汉
快递员
健身教练
出租车司机
养蜂人
小学生
中学生
工厂工人
片警
退休
政府官员
上市公司老板
渔民
厂长
货车司机
种地农民
幼儿园清洁工
中心学校校长
幼儿园学生
学校厨师长
退休老人
老年服务中心主管
村支书
派出所民警
病人
医生
水产养殖户
家庭主妇
旅游者""")
panel_22 = Panel("""否
是""")
panel_23 = Panel("""走路
自行车
电瓶车
公交车
汽车
班车""")
panel_24 = Panel("""/
;
-
~""")
所有职业_4 = Text()
所有建筑类型_2 = Text()
所有是否 = Text()
所有出行方式_3 = Text()
所有出行方式_4 = Text(panel_23)
结构符号 = Text(panel_24)
所有职业_5 = Text(panel_21)
所有建筑类型_3 = Text(panel_20)
所有是否_2 = Text(panel_22)
bang_5 = ExplodeTree(Data=simplify(读取excel0_2_5))  # -> Branch0, Branch1, Branch2, Branch3
item_2 = ListItem(List=结构符号, Index=0, Wrap=True)  # -> Item, Item1, Item2, Item3
出行方式_2 = Text()
起床区间_2 = Text()
cluster_2 = Cluster_2(
    所有建筑类型=所有建筑类型_3,
    所有是否=所有是否_2,
    事件=bang_5.Branch0,
    时间区间=bang_5.Branch1,
    建筑类型=bang_5.Branch2,
    是否重复地点=bang_5.Branch3,
    结构符号=panel_24)
bang_6 = ExplodeTree(Data=simplify(读取excel0_2_2))  # -> Branch0, Branch1, Branch2, Branch3
职业_4 = Text(职业_3)
起床区间_3 = Text(bang_4.Branch0)
出行方式_3 = Text(bang_4.Branch1)
cluster_3 = Cluster_2(
    所有建筑类型=所有建筑类型_3,
    所有是否=所有是否_2,
    事件=bang_6.Branch0,
    时间区间=bang_6.Branch1,
    建筑类型=bang_6.Branch2,
    是否重复地点=bang_6.Branch3,
    结构符号=panel_24)
mindex_5 = MemberIndex(Set=所有职业_5, Member=职业_4)  # -> Index, Count
mindex_6 = MemberIndex(Set=所有出行方式_4, Member=出行方式_3)  # -> Index, Count
bang_7 = ExplodeTree(Data=simplify(读取excel0_2_4))  # -> Branch0, Branch1, Branch2, Branch3
pshift_7 = ShiftPaths(Data=mindex_5.Index, Offset=-1)
pshift_8 = ShiftPaths(Data=mindex_6.Index, Offset=-1)
cluster_4 = Cluster_2(
    所有建筑类型=所有建筑类型_3,
    所有是否=所有是否_2,
    事件=bang_7.Branch0,
    时间区间=bang_7.Branch1,
    建筑类型=bang_7.Branch2,
    是否重复地点=bang_7.Branch3,
    结构符号=panel_24)
bang_8 = ExplodeTree(Data=simplify(读取excel0_2_3))  # -> Branch0, Branch1, Branch2, Branch3
职业序号_2 = Integer(mindex_5.Index)
出行方式序号_2 = Integer(pshift_8)
cluster_5 = Cluster_2(
    所有建筑类型=所有建筑类型_3,
    所有是否=所有是否_2,
    事件=bang_8.Branch0,
    时间区间=bang_8.Branch1,
    建筑类型=bang_8.Branch2,
    是否重复地点=bang_8.Branch3,
    结构符号=panel_24)
join_9 = TextJoin(Text=出行方式序号_2, Join=item_2.Item2)
panel_25 = Panel("政府官员/处理文件-接待上访-走访民众-会议;3~6-2~4-2~4-0.5~5;政府-政府-普通小区~河边旧民居~别墅~农田自建房~工厂~农田~老年活动中心-政府;是-是-否-是/打牌-钓鱼-拜访朋友-嫖娼;2~5-1.5~4-2~6-0.5~10;棋牌室-鱼塘-普通小区~河边旧民居~别墅~工厂~茶馆-别墅~洗浴中心~宾馆;否-是-否-否/面馆早饭-机构食堂-餐馆吃饭-回家吃饭;0.2~1-0.2~1.5-0.5~3-0.5~3;小饭馆-政府-小饭馆-别墅;是-是-否-是/回家睡觉-暂住宾馆;7~10-7~11;别墅-宾馆-洗浴中心;是-是-是/6:00~9:30/走路-班车-汽车")
merge_3 = Merge(
    Data1=flatten(职业序号_2),
    Data2=flatten(cluster_2),
    Data3=flatten(cluster_3),
    Data4=flatten(cluster_4),
    Data5=flatten(cluster_5),
    Data6=flatten(起床区间_3),
    Data7=flatten(join_9))
join_10 = TextJoin(Text=merge_3, Join=item_2.Item)
转义基因条 = Text("18/0-1-2-3;3~6-2~4-2~4-0.5~5;14~14~0~1~2~4~5~9~12~14;1-1-0-1/0-1-2-3;3~6-2~4-2~4-0.5~5;14~14~0~1~2~4~5~9~12~14;1-1-0-1/0-1-2-3;3~6-2~4-2~4-0.5~5;14~14~0~1~2~4~5~9~12~14;1-1-0-1/0-1-2-3;3~6-2~4-2~4-0.5~5;14~14~0~1~2~4~5~9~12~14;1-1-0-1/6:00~9:30/0-5-4")
panel_26 = Panel(转义基因条)
转义基因条_2 = Text(join_10)
cluster_6 = Cluster_3(转义基因条=转义基因条)
转义基因条_3 = Text(转义基因条_2)
转义基因条_4 = Text(cluster_6)

# ==== cluster 读取Excel02
开读 = ClusterInput()
路径 = ClusterInput()
表名 = ClusterInput()
列号 = ClusterInput()
首行 = ClusterInput()
尾行 = ClusterInput()
结构 = ClusterInput()
表名_2 = Text(表名)
开读_2 = Boolean(开读)
路径_2 = Text(路径)
列号_2 = Integer(列号)
首行_2 = Integer(首行)
尾行_2 = Integer(尾行)
结构_2 = Boolean(结构)
vb = VBScript(read=开读_2, FilePath=路径_2, SheetName=表名_2, Column=列号_2, startRow=首行_2, endRow=尾行_2, isStructed=结构_2)  # -> out, A
# ---------- vb: VB ----------
    If read = True Then
      Dim xl As Object
      Dim xlbook As Object
      xl = CreateObject("excel.application")
      'xl.Visible = False
      Dim st As Object
      xlbook = xl.Workbooks.Open(FilePath)
      st = xlbook.Worksheets(SheetName)

      'Dim ans As String
      'ans = st.Cells(i, j).Value
      Dim i As Integer
      Dim lst(endRow-startRow) As String
      Dim value As String
      Dim j As Integer
      j = 0
      For i = startRow To endRow Step 1
        value = st.Cells(i, Column).value
        If (value = "" And isStructed = False) Then
          Continue For
        End If
        lst(j) = value
        j = j + 1
      Next
      ReDim Preserve lst(j - 1)
      A = lst
      xl.Workbooks.close
      xl.quit
      xl = Nothing
      xlbook = Nothing
    End If
# ---------- end vb ----------
数据 = Data(vb.A)
数据_2 = ClusterOutput(数据)

# ==== cluster Cluster
panel = Panel("""工厂叉车司机
地头混混
幼儿园老师
啃老族
打零工
扫地工人
水果小贩
小老板
流浪汉
快递员
健身教练
出租车司机
养蜂人
小学生
中学生
工厂工人
片警
退休
政府官员
上市公司老板
渔民
厂长
货车司机
种地农民
幼儿园清洁工
中心学校校长
幼儿园学生
学校厨师长
退休老人
老年服务中心主管
村支书
派出所民警
病人
医生
水产养殖户
家庭主妇
旅游者""")
panel_2 = Panel("""普通小区
河边旧民居
别墅
船
农田自建房
工厂
菜市场
宾馆
小饭馆
农田
学校
警署
老年活动中心
医院
政府
棋牌室
公园
超市
茶馆
网吧
鱼塘
洗浴中心
咖啡馆""")
panel_3 = Panel("""否
是""")
panel_4 = Panel("""走路
自行车
电瓶车
公交车
汽车
班车""")
所有职业 = ClusterInput()
所有建筑类型 = ClusterInput()
所有是否 = ClusterInput()
所有出行方式 = ClusterInput()
所有出行方式_2 = Text(所有出行方式)
所有是否_2 = Text(所有是否)
所有建筑类型_2 = Text(所有建筑类型)
panel_5 = Panel("""/
;
-
~""")
所有职业_2 = Text(所有职业)
item = ListItem(List=panel_5, Index=0, Wrap=True)  # -> Item, Item1, Item2, Item3
是否重复地点 = ClusterInput()
起床区间 = ClusterInput()
出行方式 = ClusterInput()
建筑类型 = ClusterInput()
时间区间 = ClusterInput()
职业 = ClusterInput()
事件 = ClusterInput()
是否重复地点_2 = Text(是否重复地点)
职业_2 = Text(职业)
事件_2 = Text(事件)
时间区间_2 = Text(时间区间)
建筑类型_2 = Text(建筑类型)
起床区间_2 = Text(起床区间)
出行方式_2 = Text(出行方式)
lng = ListLength(List=事件_2)
mindex = MemberIndex(Set=所有职业_2, Member=职业_2)  # -> Index, Count
split = TextSplit(Text=建筑类型_2, Separators=item.Item3)
mindex_2 = MemberIndex(Set=所有是否_2, Member=是否重复地点_2)  # -> Index, Count
mindex_3 = MemberIndex(Set=所有出行方式_2, Member=出行方式_2)  # -> Index, Count
pshift = ShiftPaths(Data=split, Offset=-1)
series = Series(Start=0, Step=1, Count=lng)
pshift_2 = ShiftPaths(Data=mindex.Index, Offset=-1)
mindex_4 = MemberIndex(Set=所有建筑类型_2, Member=pshift)  # -> Index, Count
pshift_3 = ShiftPaths(Data=mindex_2.Index, Offset=-1)
pshift_4 = ShiftPaths(Data=mindex_3.Index, Offset=-1)
pshift_5 = ShiftPaths(Data=series, Offset=-1)
职业序号 = Integer(mindex.Index)
事件序号 = Integer(pshift_5)
pshift_6 = ShiftPaths(Data=mindex_4.Index, Offset=-1)
是否重复地点布尔 = Integer(pshift_3)
出行方式序号 = Integer(pshift_4)
建筑类型序号 = Text(pshift_6)
join = TextJoin(Text=事件序号, Join=item.Item2)
join_2 = TextJoin(Text=时间区间_2, Join=item.Item2)
join_3 = TextJoin(Text=建筑类型序号, Join=item.Item3)
join_4 = TextJoin(Text=是否重复地点布尔, Join=item.Item2)
join_5 = TextJoin(Text=出行方式序号, Join=item.Item2)
merge = Merge(Data1=join, Data2=join_2, Data3=join_3, Data4=join_4)  # -> flatten(Result)
join_6 = TextJoin(Text=merge, Join=item.Item1)
merge_2 = Merge(Data1=flatten(职业序号), Data2=flatten(join_6), Data3=flatten(起床区间_2), Data4=flatten(join_5))
join_7 = TextJoin(Text=merge_2, Join=item.Item)
转义基因条 = Text(join_7)
转义基因条_2 = ClusterOutput(转义基因条)

# ==== cluster Cluster_2
所有建筑类型 = ClusterInput()
所有是否 = ClusterInput()
结构符号 = ClusterInput()
结构符号_2 = Text(结构符号)
所有是否_2 = Text(所有是否)
所有建筑类型_2 = Text(所有建筑类型)
item = ListItem(List=结构符号_2, Index=0, Wrap=True)  # -> Item, Item1, Item2, Item3
是否重复地点 = ClusterInput()
建筑类型 = ClusterInput()
时间区间 = ClusterInput()
事件 = ClusterInput()
是否重复地点_2 = Text(是否重复地点)
建筑类型_2 = Text(建筑类型)
事件_2 = Text(事件)
时间区间_2 = Text(时间区间)
lng = ListLength(List=事件_2)
split = TextSplit(Text=建筑类型_2, Separators=item.Item3)
mindex = MemberIndex(Set=所有是否_2, Member=是否重复地点_2)  # -> Index, Count
pshift = ShiftPaths(Data=split, Offset=-1)
series = Series(Start=0, Step=1, Count=lng)
mindex_2 = MemberIndex(Set=所有建筑类型_2, Member=pshift)  # -> Index, Count
pshift_2 = ShiftPaths(Data=mindex.Index, Offset=-1)
pshift_3 = ShiftPaths(Data=series, Offset=-1)
事件序号 = Integer(pshift_3)
pshift_4 = ShiftPaths(Data=mindex_2.Index, Offset=-1)
是否重复地点布尔 = Integer(pshift_2)
建筑类型序号 = Text(pshift_4)
join = TextJoin(Text=事件序号, Join=item.Item2)
join_2 = TextJoin(Text=时间区间_2, Join=item.Item2)
join_3 = TextJoin(Text=建筑类型序号, Join=item.Item3)
join_4 = TextJoin(Text=是否重复地点布尔, Join=item.Item2)
merge = Merge(Data1=join, Data2=join_2, Data3=join_3, Data4=join_4)  # -> flatten(Result)
join_5 = TextJoin(Text=merge, Join=item.Item1)
四参数 = Text(join_5)
四参数_2 = ClusterOutput(四参数)

# ==== cluster Cluster_3
转义基因条 = ClusterInput()
panel = Panel("""/
;
-
~""")
转义基因条_2 = Text(转义基因条)
item = ListItem(List=panel, Index=0, Wrap=True)  # -> Item, Item1, Item2, Item3
split = TextSplit(Text=转义基因条_2, Separators=item.Item)
split_2 = TextSplit(Text=split, Separators=item.Item1)
split_3 = TextSplit(Text=split_2, Separators=item.Item2)
split_4 = TextSplit(Text=split_3, Separators=item.Item3)
pshift = ShiftPaths(Data=split_4, Offset=2)
拆解转义基因条 = Data(pshift)
拆解转义基因条_2 = ClusterOutput(拆解转义基因条)
