# Grasshopper definition 20181101_tim_areaToLengthAndWidth.gh (Grasshopper 1.0.4)

genes = GenePool(Decimals=2, Maximum=100, Minimum=0, Value=[0.95, 40.65])
genes_2 = GenePool(Decimals=2, Maximum=100, Minimum=0, Value=[4.91, 44.44])
genes_3 = GenePool(Decimals=2, Maximum=100, Minimum=0, Value=[29.67, 29.74])
深度范围 = Number(genes_2)
宽深 = Number(genes_3)
宽度范围 = Number(genes)
面积 = Number(Slider(200, range=0..1000))
面积换算宽深0_1 = 面积换算宽深01(面积=面积, 宽度范围=宽度范围, 深度范围=深度范围, 宽深=宽深)  # -> 宽_2, 深_2
xy = XYPlane(Origin=Point(0, 0, 0))
宽 = Number(面积换算宽深0_1.宽_2)
深 = Number(面积换算宽深0_1.深_2)
rectangle = Rectangle(Plane=xy, XSize=宽, YSize=深, Radius=0)  # -> Rectangle, Length

# ==== cluster 面积换算宽深01
面积 = ClusterInput()
宽度范围 = ClusterInput()
深度范围 = ClusterInput()
宽深 = ClusterInput()
深度范围_2 = Number(深度范围)
宽深_2 = Number(宽深)
面积_2 = Number(面积)
宽度范围_2 = Number(宽度范围)
rec = DataRecorder(宽深_2, DataLimit=4, RecordData=True)
item = ListItem(List=宽深_2, Index=0, Wrap=True)  # -> Item, Item1
item_2 = ListItem(List=rec, Index=0, Wrap=True)  # -> Item, Item1, Item2, Item3
subtraction = Subtraction(A=item_2.Item, B=item_2.Item2)
subtraction_2 = Subtraction(A=item_2.Item1, B=item_2.Item3)
bool = Boolean(subtraction_2)
bool_2 = Boolean(subtraction)
mindex = MemberIndex(Set=[bool_2, bool], Member=Toggle(True))  # -> Index, Count
not = GateNot(A=mindex.Index)
bool_3 = Boolean(not)
python = GhPythonScript(area=面积_2, length_domain=宽度范围_2, width_domain=深度范围_2, length=item.Item, width=item.Item1, flag=bool_3)  # -> out, length, width; inputs length_domain: list, width_domain: list, flag: Boolean
# ---------- python: Python ----------
#!/usr/bin/env python
#-*- coding: utf-8 -*-

# 面积转换宽深机制
def limit(length, length_domain):
    # 把长度限制在值域范围内
    length = length_domain[0] if length < length_domain[0] else (length_domain[1] if length > length_domain[1] else length)
    return length
    

def recomputeDomain(area, length_domain, width_domain):
   # 根据面积, 对宽深范围重新计算, 得到在限制一次后, 不会超出的范围
    l_d1 = area/width_domain[1]  # 得到最大深时的最小宽
    l_d2 = area/width_domain[0]  # 得到最小深时的最大宽
    if l_d1 > length_domain[0]: length_domain[0] = l_d1
    if l_d2 < length_domain[1]: length_domain[1] = l_d2

    l_w1 = area/length_domain[1]  # 得到最大宽时的最小深
    l_w2 = area/length_domain[0]  # 得到最小宽时的最大深
    if l_w1 > width_domain[0]: width_domain[0] = l_w1
    if l_w2 < width_domain[1]: width_domain[1] = l_w2
    print(length_domain, width_domain)
    return length_domain, width_domain
    

def convertArea(area, length_domain, width_domain, length, width, flag):
    """
    给定面积, 宽深范围, 改变宽深中的一个值, 确定另外一个值
    @params:
    area: 面积 float
    length_domian: 宽值范围 float[2]
    width_domain: 深值范围 float[2]
    length:   宽度 float
    width:    深度 float
    flag:     当前确定的是宽还是深度, 1 -> 宽, 0 -> 深
    """
    area = float(area)  # ? 如何定义好呢
    length_domian, width_domain = recomputeDomain(area, length_domain, width_domain)
    if flag:
        length = limit(length, length_domain)
        width = area / length
    else:
        width = limit(width, width_domain)
        length = area / width
    return length, width
    

def main():
    return convertArea(area, length_domain, width_domain, length, width, flag)

length, width = main()
# ---------- end python ----------
深 = Number(python.width)
宽 = Number(python.length)
深_2 = ClusterOutput(深)
宽_2 = ClusterOutput(宽)
