# Grasshopper definition displayArrangeArchWithEdgePolyInGH.gh (Grasshopper 1.0.4)

genes = GenePool(Decimals=2, Maximum=30, Minimum=0, Value=[15, 15, 15, 15])
genes_2 = GenePool(Decimals=2, Maximum=30, Minimum=0, Value=[12.94, 15, 15, 15])
genes_3 = GenePool(Decimals=2, Maximum=100, Minimum=0, Value=[18.4, 8.77, 0, 0])
genes_4 = GenePool(Decimals=2, Maximum=100, Minimum=0, Value=[76.05, 50, 50, 50])
genes_5 = GenePool(Decimals=2, Maximum=30, Minimum=0, Value=[15, 15, 15, 15])
genes_6 = GenePool(Decimals=2, Maximum=30, Minimum=0, Value=[16.04, 9.81, 18.11, 16.04])
genes_7 = GenePool(Decimals=2, Maximum=30, Minimum=0, Value=[15.89, 15, 15, 15])
genes_8 = GenePool(Decimals=2, Maximum=30, Minimum=0, Value=[15, 15, 15, 15])
genes_9 = GenePool(Decimals=0, Maximum=1, Minimum=0, Value=[0.5, 0.5, 0.5, 0.5])
genes_10 = GenePool(Decimals=0, Maximum=1, Minimum=0, Value=[0.5, 0.5, 0.5, 0.5])
pline = PolyLine(Vertices=[Point(-188.7330225, -7.688803549, 0), Point(-79.06710367, -7.688803549, 0)], Closed=False)
pline_2 = PolyLine(
    Vertices=[Point(-182.7739372, -31.72713519, 0), Point(-108.4858587, -79.31793554, 0), Point(35.44729361, -51.45990607, 0), Point(115.5391283, 59.97221182, 0)],
    Closed=False)
num = Number(genes)
num_2 = Number(genes_2)
num_3 = Number(genes_3)
crv = Curve(pline)
num_4 = Number(genes_4)
num_5 = Number(genes_5)
num_6 = Number(genes_6)
num_7 = Number(genes_7)
num_8 = Number(genes_8)
int = Integer(genes_9)
int_2 = Integer(genes_10)
python = GhPythonScript(
    poly_gh=crv,
    area_lst=num_4,
    dist_lst=num_3,
    length_domain_left_lst=num_2,
    length_domain_right_lst=num,
    width_domain_left_lst=num_7,
    width_domain_right_lst=num_6,
    length_lst=num_8,
    width_lst=num_5,
    flag_lst=int,
    arrangeClass_lst=int_2)  # -> out, poly_gh_lst; inputs area_lst: list, dist_lst: list, length_domain_left_lst: list, length_domain_right_lst: list, width_domain_left_lst: list, width_domain_right_lst: list, length_lst: list, width_lst: list, flag_lst: list of Int32, arrangeClass_lst: list of Int32
# ---------- python: Python ----------
#!/usr/bin/env python
#-*- coding: utf-8 -*-
from ghDisplay import GHDisplay

poly_gh_lst = GHDisplay.displayArrangeArchWithEdgePoly(poly_gh,
                                       area_lst, dist_lst,
                                       length_domain_left_lst, length_domain_right_lst,
                                       width_domain_left_lst, width_domain_right_lst,
                                       length_lst, width_lst, flag_lst,
                                       arrangeClass_lst)
# ---------- end python ----------
