# Grasshopper definition 20181002_tim_convertBetweenExcelAndGh.gh (Grasshopper 1.0.4)

# ----
# 1,把xlrd, xlwt, xlutils三个文件夹已入rhino路径文件夹中，如:D:\Program Files\Rhino 6\Plug-ins\IronPython\Lib
# 3,暂时不支持xlsx
cluster = Cluster(工作簿名称="Sheet1")  # -> out, data; disabled
cluster_2 = Cluster_2()  # disabled

txt = Text("C:\Users\chen\Desktop\test-tim.xls")
txt_2 = Text("Sheet1")
int = Integer(Slider(1, range=0..1))
int_2 = Integer(Slider(105, range=0..1000))
int_3 = Integer(Slider(2, range=0..10))
series = Series(Start=Slider(2, range=0..10), Step=1, Count=Slider(8, range=0..10))
列序号 = Integer(series)
有空值数据 = Data(["普通小区", "河边旧民宅", "普通小区", "普通小区", "出租房", "街上", "菜市场", "高档小区", "菜场门口", "快递站"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])
cluster_3 = Cluster(开始读=Toggle(False), xls文件路径=txt, 工作簿名称=txt_2, 列序号=列序号, 起始行号=int_3, 结束行号=int_2, 是否保留结构=Toggle(True))  # -> out, data
cset = CreateSet(List=cluster_3.data)  # -> Set, Map
panel = Panel("C:\Users\chen\Desktop\test-tim-test.xls")
toggle = BooleanToggle(True)
number_slider = Slider(1, range=0..10)
无空值数据 = Data([10, 1, 1, 9, 8, 9, 9, 14, 14, 9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])
无空值数据_2 = Data(["普通小区", "工厂车间", "工厂食堂", "小饭馆", "河边旧民宅", "网吧", "娱乐场所", "幼儿园", "幼儿园食堂", "超市"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])
cluster_4 = Cluster_2(
    开始写=Toggle(False),
    存在文件路径="C:\Users\chen\Desktop\test-tim-test.xls",
    表名="实际场所",
    数据=有空值数据,
    工作簿名称="output_hash1",
    列序号=Slider(3, range=0..10),
    起始行=Slider(1, range=0..10),
    是否保留结构=Toggle(False))
panel_2 = Panel("""7
8""")
cluster_5 = Cluster_2(
    开始写=Toggle(False),
    存在文件路径=panel,
    表名="实际场所",
    数据=无空值数据_2,
    工作簿名称="output_hash1",
    列序号=Slider(1, range=0..1),
    起始行=number_slider,
    是否保留结构=toggle)
cluster_6 = Cluster(开始读=Toggle(True), xls文件路径=txt, 工作簿名称="arr1", 列序号=panel_2, 起始行号="2", 结束行号="125", 是否保留结构=Toggle(True))  # -> out, data
data = Data(cluster_3.data)
bang = ExplodeTree(Data=simplify(cluster_6.data))  # -> Branch0, Branch1
replace = ReplaceMembers(Set=data, Find=bang.Branch0, Replace=bang.Branch1)  # -> simplify(Result)
cluster_7 = Cluster_2(
    开始写=Toggle(False),
    存在文件路径=panel,
    表名="所属地块分类编号",
    数据=无空值数据,
    工作簿名称="output_hash1",
    列序号=Slider(2, range=0..10),
    起始行=number_slider,
    是否保留结构=toggle)
viewer = ParamViewer(replace)
list = ValueList({"6:30-8:00": 0, "8:00-11:30": 1, "11:30-14:00": 2, "14:00-17:30": 3, "17:30-19:30": 4, "19:30-22:00": 5, "22:00-2:00": 6, "2:00-6:30": 7}, selected="6:30-8:00")
path = DataPath(viewer)
区块类型_完整版 = Data(["厂区", "加油站", "农田", "机械厂", "制管厂", "综合楼", "空地", "铸金厂", "路政", "农田"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])
区块类型_整理版 = Data(["厂区", "加油站", "农田", "厂区", "厂区", "综合楼", "空地", "厂区", "政府机构", "农田"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])
地块个数 = Integer(Slider(15, range=0..100))
区块类型 = Text(["厂区", "加油站", "农田", "综合楼", "空地", "政府机构", "绿化", "住宅区", "沿街商铺", "小区", "医院", "社区服务中心", "停车场", "学校", "教堂(社)"])
区块边界 = Curve(Tree({0;0;0;0}: [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], {0;1;0;0}: [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], {0;2;0;0}: [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], {0;3;0;0}: [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], {0;4;0;0}: [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], {0;5;0;0}: [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]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))
时段 = Integer(list)
颜色 = Number(Slider(0, range=0..255))
区块面 = Surface(Tree({0;0}: [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], {0;1}: [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], {0;2}: [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], {0;3}: [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], {0;4}: [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], {0;5}: [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]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))
data_2 = Data(Tree({0;0}: ["厂区", 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, 1, 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, 1, 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, 1, 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, 2], {0;1}: ["加油站", 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, 6, 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, 1, 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, 1, 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, 6], {0;2}: ["农田", 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, 4, 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, 1, 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, 4, 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, 6, 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, 1, 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, 4, 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, 2], {0;3}: ["机械厂", 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, 1, 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, 1, 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, 4, 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, 4], {0;4}: ["制管厂", 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, 4, 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, 1, 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, 4, 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, 1, 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, 1, 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, 2], {0;5}: ["综合楼", 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, 1, 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, 1, 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, 1, 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, 4]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))
item = ListItem(List=path, Index=时段, Wrap=False)
series_2 = Series(Start=1, Step=1, Count=地块个数)
branch = TreeBranch(Tree=replace, Path=item, MaintainPaths=True)
int_4 = Integer(branch)
int_5 = Integer(series_2)
mindex = MemberIndex(Set=int_4, Member=int_5)  # -> Index, Count

# ----
# 色域显示
data_3 = Data(flatten(mindex.Count))
sort = SortList(Keys=data_3)  # -> Keys, ValuesA
item_2 = ListItem(List=sort.Keys, Index="-1", Wrap=True)
remap = RemapNumbers(Value=data_3, Source=item_2, Target=Domain(0, 255))  # -> Mapped, Clipped
rgb = ColourRGB(Alpha=255, Red=remap.Mapped, Green=颜色, Blue=颜色)  # -> graft(Colour)
preview = CustomPreview(Geometry=区块面, Material=rgb)

# ----
# 文字显示
boxprop = BoxProperties(Box=区块面)  # -> Center, Diagonal, Area, Volume, Degeneracy
data_4 = Data(graft(["厂区", "加油站", "农田", "综合楼", "空地", "政府机构", "绿化", "住宅区", "沿街商铺", "小区", "医院", "社区服务中心", "停车场", "学校", "教堂(社)"]))
pt = Point(boxprop.Center)
col = Colour([RGB(145, 109, 105), RGB(255, 183, 0), RGB(158, 209, 86), RGB(156, 69, 255), RGB(145, 92, 32), RGB(212, 99, 129), RGB(0, 153, 5), RGB(201, 195, 141), RGB(227, 61, 61), RGB(180, 186, 67), RGB(255, 130, 130), RGB(173, 116, 116), RGB(153, 153, 153), RGB(237, 209, 145), RGB(155, 104, 171)])
tag = TextTag(Location=pt, Text=data_4, Colour=col)

# ==== cluster Cluster
开始读 = ClusterInput()
xls文件路径 = ClusterInput()
工作簿名称 = ClusterInput()
列序号 = ClusterInput()
起始行号 = ClusterInput()
结束行号 = ClusterInput()
是否保留结构 = ClusterInput()
xls文件路径_2 = Text(xls文件路径)
工作簿名称_2 = Text(工作簿名称)
是否保留结构_2 = Boolean(是否保留结构)
开始读_2 = Boolean(开始读)
结束行号_2 = Integer(结束行号)
起始行号_2 = Integer(起始行号)
列序号_2 = Integer(列序号)
python = GhPythonScript(read=开始读_2, filepath=xls文件路径_2, worksheetname=工作簿名称_2, column=列序号_2, startRow=起始行号_2, endRow=结束行号_2, isStructed=是否保留结构_2)  # -> out, data; inputs isStructed: Boolean
# ---------- python: Python ----------
# -*- coding: utf-8 -*-
"""Provides a scripting component.
    依赖xlrd和xlwt, 确认~\Rhino 6\Plug-ins\IronPython\Lib中存在他们
    Inputs:
        read: 
        filepath: 
        worksheetname:
        column:
        startRow:
        endRow:
        isStructed: 是否保留结构
    Output:
        Data: The a output variable"""

__author__ = "chen"
__version__ = "2018.10.02"

import rhinoscriptsyntax as rs
from xlrd import open_workbook
from xlwt import Workbook


def main():
    data = []
    input_file = filepath
    input_workbook = open_workbook(input_file)
    
    with open_workbook(input_file) as workbook:
        # if worksheet.nrows < startRow or worksheet.nrows < endRow or colum    边界条件
        worksheet = workbook.sheet_by_name(worksheetname)
        for row_index in range(startRow, endRow+1):
            value = worksheet.cell_value(row_index-1, column-1)
            if (not isStructed and value == ''):continue;
            data.append(value)
    return data

if (read):
    data = main()
# ---------- end python ----------
data = ClusterOutput(python.data)
out = ClusterOutput(python.out)

# ==== cluster Cluster_2
开始写 = ClusterInput()
表名 = ClusterInput()
数据 = ClusterInput()
工作簿名称 = ClusterInput()
列序号 = ClusterInput()
起始行 = ClusterInput()
是否保留结构 = ClusterInput()
存在文件路径 = ClusterInput()
开始写_2 = Boolean(开始写)
存在文件路径_2 = Text(存在文件路径)
表名_2 = Text(表名)
数据_2 = Text(数据)
工作簿名称_2 = Text(工作簿名称)
列序号_2 = Integer(列序号)
起始行_2 = Integer(起始行)
是否保留结构_2 = Boolean(是否保留结构)
python = GhPythonScript(
    Write=开始写_2,
    FilePath=存在文件路径_2,
    Table=表名_2,
    Data=数据_2,
    WorkSheetName=工作簿名称_2,
    Column=列序号_2,
    StartRow=起始行_2,
    IsStructed=是否保留结构_2)  # -> out; inputs Data: list
# ---------- python: Python ----------
# -*- coding: utf-8 -*-
"""Provides a scripting component.
    在已经存在的excel中写入
    依赖xlrd和xlutils, 确认~\Rhino 6\Plug-ins\IronPython\Lib中存在他们
    Inputs:
        Write: 
        Table:
        Data:
        FilepPath: 
        WorkSheetName:
        Column:
        StartRow:
        IsStructed: 是否保留结构
    Output:
        out: The a output variable"""

__author__ = "mituh"
__version__ = "2018.10.02"

import rhinoscriptsyntax as rs
from xlrd import open_workbook
#from xlwt import Workbook
from xlutils.copy import copy

def find_sheet_index(sheetName, rbook):
    sheet_i = 0
    names = rbook.sheet_names()
    for i in range(len(names)):
        if (names[i] == sheetName):
            sheet_i = i
            return i
    return -1

def main():
    rbook = open_workbook(FilePath)
    workbook = copy(rbook)
    sheet_i = find_sheet_index(WorkSheetName, rbook)
    if (sheet_i == -1):
        print('Error')
        return
    worksheet = workbook.get_sheet(sheet_i)
    worksheet.write(StartRow-1, Column-1, Table)
    DataStartRow = StartRow + 1
    i = DataStartRow
    for row_index in range(DataStartRow, DataStartRow+len(Data)):
        value = Data[row_index-DataStartRow]
        if (not IsStructed and value == ''):continue;
        worksheet.write(i-1, Column-1, value)
        i+=1
    workbook.save(FilePath)
    print("Ok")

if (Write):
    main()
# ---------- end python ----------
out = ClusterOutput(python)
