# Grasshopper definition 20181009_tim_testAgain.gh (Grasshopper 1.0.4)

# ----
# 1,把xlrd, xlwt, xlutils三个文件夹已入rhino路径文件夹中，如:D:\Program Files\Rhino 6\Plug-ins\IronPython\Lib
# 3,暂时不支持xlsx
cluster = Cluster(工作簿名称="Sheet1")  # -> out, data; disabled
cluster_2 = Cluster_2()  # disabled

int = Integer(Slider(1, range=0..1))
int_2 = Integer(Slider(105, range=0..1000))
int_3 = Integer(Slider(2, range=0..10))
txt = Text("C:\Users\htwt\Desktop\test-tim.xls")
panel = Panel("C:\Users\htwt\Desktop\test.xls")
toggle = BooleanToggle(False)
number_slider = Slider(1, range=0..10)
number_slider_2 = Slider(11, range=0..100)
panel_2 = Panel("timl")
panel_3 = Panel("实际场所")
toggle_2 = BooleanToggle(False)
有空值数据 = Data(["普通小区", "河边旧民宅", "普通小区", "普通小区", "出租房", "街上", "菜市场", "高档小区", "菜场门口", "快递站"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])
vb = VBScript(
    read=Toggle(False),
    FilePath=txt,
    SheetName="Sheet1",
    Column=Slider(1, range=0..1),
    startRow=int_3,
    endRow=int_2,
    isStructed=Toggle(False))  # -> out, A; same code as vb
开写 = Boolean()
路径 = Text()
数据 = Data()
表名 = Text()
标题 = Text()
列号 = Integer()
首行 = Integer()
结构 = Boolean()
vb_2 = VBScript(Write=开写, FilePath=路径, Data=数据, SheetName=表名, TableName=标题, Column=列号, startRow=首行, isStructed=结构)  # -> out, A; inputs Data: list; same code as vb
数据_2 = Data(vb.A)
读 = 读()
写 = 写()

# ==== cluster Cluster
开始读 = ClusterInput()
xls文件路径 = ClusterInput()
工作簿名称 = ClusterInput()
列序号 = ClusterInput()
起始行号 = ClusterInput()
结束行号 = ClusterInput()
是否保留结构 = ClusterInput()
xls文件路径_2 = Text(xls文件路径)
工作簿名称_2 = Text(工作簿名称)
是否保留结构_2 = Boolean(是否保留结构)
开始读_2 = Boolean(开始读)
结束行号_2 = Integer(结束行号)
起始行号_2 = Integer(起始行号)
列序号_2 = Integer(列序号)
python = GhPythonScript(read=开始读_2, filepath=xls文件路径_2, worksheetname=工作簿名称_2, column=列序号_2, startRow=起始行号_2, endRow=结束行号_2, isStructed=是否保留结构_2)  # -> out, data; inputs isStructed: Boolean
# ---------- python: Python ----------
# -*- coding: utf-8 -*-
"""Provides a scripting component.
    依赖xlrd和xlwt, 确认~\Rhino 6\Plug-ins\IronPython\Lib中存在他们
    Inputs:
        read: 
        filepath: 
        worksheetname:
        column:
        startRow:
        endRow:
        isStructed: 是否保留结构
    Output:
        Data: The a output variable"""

__author__ = "chen"
__version__ = "2018.10.02"

import rhinoscriptsyntax as rs
from xlrd import open_workbook
from xlwt import Workbook


def main():
    data = []
    input_file = filepath
    input_workbook = open_workbook(input_file)
    
    with open_workbook(input_file) as workbook:
        # if worksheet.nrows < startRow or worksheet.nrows < endRow or colum    边界条件
        worksheet = workbook.sheet_by_name(worksheetname)
        for row_index in range(startRow, endRow+1):
            value = worksheet.cell_value(row_index-1, column-1)
            if (not isStructed and value == ''):continue;
            data.append(value)
    return data

if (read):
    data = main()
# ---------- end python ----------
data = ClusterOutput(python.data)
out = ClusterOutput(python.out)

# ==== cluster Cluster_2
开始写 = ClusterInput()
表名 = ClusterInput()
数据 = ClusterInput()
工作簿名称 = ClusterInput()
列序号 = ClusterInput()
起始行 = ClusterInput()
是否保留结构 = ClusterInput()
存在文件路径 = ClusterInput()
开始写_2 = Boolean(开始写)
存在文件路径_2 = Text(存在文件路径)
表名_2 = Text(表名)
数据_2 = Text(数据)
工作簿名称_2 = Text(工作簿名称)
列序号_2 = Integer(列序号)
起始行_2 = Integer(起始行)
是否保留结构_2 = Boolean(是否保留结构)
python = GhPythonScript(
    Write=开始写_2,
    FilePath=存在文件路径_2,
    Table=表名_2,
    Data=数据_2,
    WorkSheetName=工作簿名称_2,
    Column=列序号_2,
    StartRow=起始行_2,
    IsStructed=是否保留结构_2)  # -> out; inputs Data: list
# ---------- python: Python ----------
# -*- coding: utf-8 -*-
"""Provides a scripting component.
    在已经存在的excel中写入
    依赖xlrd和xlutils, 确认~\Rhino 6\Plug-ins\IronPython\Lib中存在他们
    Inputs:
        Write: 
        Table:
        Data:
        FilepPath: 
        WorkSheetName:
        Column:
        StartRow:
        IsStructed: 是否保留结构
    Output:
        out: The a output variable"""

__author__ = "mituh"
__version__ = "2018.10.02"

import rhinoscriptsyntax as rs
from xlrd import open_workbook
#from xlwt import Workbook
from xlutils.copy import copy

def find_sheet_index(sheetName, rbook):
    sheet_i = 0
    names = rbook.sheet_names()
    for i in range(len(names)):
        if (names[i] == sheetName):
            sheet_i = i
            return i
    return -1

def main():
    rbook = open_workbook(FilePath)
    workbook = copy(rbook)
    sheet_i = find_sheet_index(WorkSheetName, rbook)
    if (sheet_i == -1):
        print('Error')
        return
    worksheet = workbook.get_sheet(sheet_i)
    worksheet.write(StartRow-1, Column-1, Table)
    DataStartRow = StartRow + 1
    i = DataStartRow
    for row_index in range(DataStartRow, DataStartRow+len(Data)):
        value = Data[row_index-DataStartRow]
        if (not IsStructed and value == ''):continue;
        worksheet.write(i-1, Column-1, value)
        i+=1
    workbook.save(FilePath)
    print("Ok")

if (Write):
    main()
# ---------- end python ----------
out = ClusterOutput(python)

# ==== cluster 读
开读 = ClusterInput()
路径 = ClusterInput()
表名 = ClusterInput()
列号 = ClusterInput()
首行 = ClusterInput()
尾行 = ClusterInput()
结构 = ClusterInput()
表名_2 = Text(表名)
开读_2 = Boolean(开读)
路径_2 = Text(路径)
列号_2 = Integer(列号)
首行_2 = Integer(首行)
尾行_2 = Integer(尾行)
结构_2 = Boolean(结构)
vb = VBScript(read=开读_2, FilePath=路径_2, SheetName=表名_2, Column=列号_2, startRow=首行_2, endRow=尾行_2, isStructed=结构_2)  # -> out, A
# ---------- vb: VB ----------
    If read = True Then
      Dim xl As Object
      Dim xlbook As Object
      xl = CreateObject("excel.application")
      'xl.Visible = False
      Dim st As Object
      xlbook = xl.Workbooks.Open(FilePath)
      st = xlbook.Worksheets(SheetName)

      'Dim ans As String
      'ans = st.Cells(i, j).Value
      Dim i As Integer
      Dim lst(endRow-startRow) As String
      Dim value As String
      Dim j As Integer
      j = 0
      For i = startRow To endRow Step 1
        value = st.Cells(i, Column).value
        If (value = "" And isStructed = False) Then
          Continue For
        End If
        'lst.AddItems(value)
        lst(j) = value
        j = j + 1
      Next
      ReDim Preserve lst(j-1)
      'A = st.Cells(i, Column).Value
      A = lst
      xl = Nothing
      xlbook = Nothing
    End If
# ---------- end vb ----------
数据 = Data(vb.A)
数据_2 = ClusterOutput(数据)

# ==== cluster 写
开写 = ClusterInput()
路径 = ClusterInput()
数据 = ClusterInput()
表名 = ClusterInput()
标题 = ClusterInput()
列号 = ClusterInput()
首行 = ClusterInput()
结构 = ClusterInput()
数据_2 = Data(数据)
结构_2 = Boolean(结构)
开写_2 = Boolean(开写)
路径_2 = Text(路径)
表名_2 = Text(表名)
标题_2 = Text(标题)
列号_2 = Integer(列号)
首行_2 = Integer(首行)
vb = VBScript(Write=开写_2, FilePath=路径_2, Data=数据_2, SheetName=表名_2, TableName=标题_2, Column=列号_2, startRow=首行_2, isStructed=结构_2)  # -> out, A; inputs Data: list
# ---------- vb: VB ----------
    If Write = True Then
      Dim xl As Object
      Dim xlbook As Object
      xl = CreateObject("excel.application")
      'xl.Visible = False
      Dim st As Object
      xlbook = xl.Workbooks.Open(FilePath)
      'check sheet exists

      Dim find As Boolean
      find = False
      Dim i As Integer
      For Each st In xlbook.WorkSheets
        If st.name = SheetName Then
          find = True
          Exit For
        End If
      Next
      If find = False Then
        st = xlbook.Worksheets.Add()
        st.Name = SheetName
      Else
        'has exists
        st = xlbook.Worksheets(SheetName)
      End If
      A = st.Name
      With st
        .Cells(startRow, Column) = TableName
        'Dim i As Integer
        Dim length As Integer
        length = Data.Count() - 1
        Dim j As Integer
        j = startRow + 1
        For i = 0 To length Step 1
          If Data(i) = "" And isStructed = False Then
            Continue For
          End If
          .Cells(j, Column) = Data(i)
          j = j + 1
        Next
        
        xlbook.Save()
        xlbook.Close()
        xl.Quit()
      End With
      xl = Nothing
      xlbook = Nothing
    End If
# ---------- end vb ----------
